# Grasshopper definition 5A_Clock-02.gh (Grasshopper 1.0.7)

reset = Button()
update = Button()
timer = Timer(TimerInterval=500, Target=clock)  # disabled
circle = Circle(Plane=PlaneXY(0, 0, 0), Radius=1)
clock = Clock(reset=reset, update=update)
modulus = Modulus(A=clock, B="60")
division = Division(A=modulus, B="60")
evaluate_curve = EvaluateCurve(Curve=reparameterize(circle), Parameter=division)  # -> Point, Tangent, Angle
point = Point(Point(0, 0, 0))
line = Line(StartPoint=evaluate_curve.Point, EndPoint=point)
panel = Panel(division)

# ==== cluster Clock
reset = ClusterInput()
update = ClusterInput()
panel = Panel("""import Rhino
data = Rhino.RhinoDoc.ActiveDoc.Notes""")
reset_2 = Boolean(reset)
update_2 = Boolean(update)
gate_or = GateOr(A=reset_2, B=update_2)
ghpython_script = GhPythonScript(Code=panel, Push=gate_or)  # -> Out, Data
number = Number(ghpython_script.Data)
stream_filter = StreamFilter(Gate=reset_2, Stream0=number, Stream1="-1")
panel_2 = Panel("""import Rhino
Rhino.RhinoDoc.ActiveDoc.Notes = data""")
_1 = Integer(1)
addition = Addition(A=stream_filter, B=_1)
text = Text(addition)
ghpython_script_2 = GhPythonScript(Code=panel_2, Data=text)  # -> Out, Data
tick = Integer(addition)
tick_2 = ClusterOutput(tick)
