# Grasshopper definition 5A_Physics-01.gh (Grasshopper 1.0.7)

setup = Setup()
update = Button()
reset = Button()
timer = Timer(TimerInterval=100, Target=control)  # disabled
control = Control(reset=reset, update=update, initial=setup)  # -> positions, velocities, masses

# ---- group: State
velocities = Vector(control.velocities)
positions = Point(control.positions)
masses = Number(control.masses)

# ----
analysis = Analysis(positions=positions, velocities=velocities, masses=masses)
integrate = Integrate(positions=positions, velocities=velocities, masses=masses, forces=analysis)  # -> positions_4, velocities_4, masses_4
display = Display(positions=control.positions, velocities=control.velocities, masses=control.masses, forces=analysis)
constraint = Constraint(positions=integrate.positions_4, velocities=integrate.velocities_4, masses=integrate.masses_4)  # -> positions_5, velocities_5, masses_5
persist = Persist(positions=constraint.positions_5, velocities=constraint.velocities_5, masses=constraint.masses_5)

# ==== cluster Setup
angle = Slider(30, range=0..90)
angle_2 = Slider(45, range=0..90)
angle_3 = Slider(60, range=0..90)
radians = Radians(Degrees=[angle, angle_2, angle_3])
sine = Sine(Value=radians)
cosine = Cosine(Value=radians)
velocity = Slider(15, range=0..100)
mass = Slider(1, range=0..100)
mass_2 = Slider(1, range=0..100)
mass_3 = Slider(1, range=0..100)
vector_xyz = VectorXYZ(XComponent=cosine, YComponent=0, ZComponent=sine)  # -> Vector, Length
point = Point(Point(0, 0, 0))
point_2 = Point(Point(0, 0, 0))
point_3 = Point(Point(0, 0, 0))
merge = Merge(Data1=point, Data2=point_2, Data3=point_3)
merge_2 = Merge(Data1=mass, Data2=mass_2, Data3=mass_3)
multiplication = Multiplication(A=vector_xyz.Vector, B=velocity)

# ---- group: States
velocities = Vector(multiplication)
positions = Point(merge)
masses = Number(merge_2)

# ----
pack = Pack(positions=positions, velocities=velocities, masses=masses)
packed = Text(pack)
packed_2 = ClusterOutput(packed)

# ==== cluster Analysis
velocities = ClusterInput()
positions = ClusterInput()
masses = ClusterInput()

# ---- group: States
velocities_2 = Vector(velocities)
positions_2 = Point(positions)
masses_2 = Number(masses)

# ---- group: Gravity
g = Slider(9.8, range=0..10)
unit_z = UnitZ(Factor=g)
negative = Negative(Value=unit_z)
multiplication = Multiplication(A=negative, B=masses_2)

# ---- group: Drag
k = Slider(0, range=0..1)
multiplication_2 = Multiplication(A=velocities_2, B=k)
negative_2 = Negative(Value=multiplication_2)

# ----
addition = Addition(A=multiplication, B=negative_2)
sumforces = Vector(addition)
sumforces_2 = ClusterOutput(sumforces)

# ==== cluster Integrate
positions = ClusterInput()
velocities = ClusterInput()
masses = ClusterInput()
forces = ClusterInput()

# ---- group: State
velocities_2 = Vector(velocities)
positions_2 = Point(positions)
masses_2 = Number(masses)

# ----
forces_2 = Vector(forces)

# ---- group: Time Step
dt = Slider(0.05, range=0.001..0.1)

# ---- group: Acceleration
a_b = GhPythonScript(A=forces_2, B=masses_2)  # -> C
# ---------- a_b: Python ----------
C = 0 if B == 0 else A / B
# ---------- end a_b ----------

# ---- group: Acceleration * dt
multiplication = Multiplication(A=a_b, B=dt)

# ---- group: Velocity += Acceleration * dt
addition = Addition(A=multiplication, B=velocities_2)

# ---- group: Velocity * dt
multiplication_2 = Multiplication(A=addition, B=dt)

# ---- group: Position += Velocity * dt
addition_2 = Addition(A=multiplication_2, B=positions_2)

# ---- group: States
positions_3 = Point(addition_2)
velocities_3 = Vector(addition)
masses_3 = Number(masses_2)

# ----
positions_4 = ClusterOutput(positions_3)
velocities_4 = ClusterOutput(velocities_3)
masses_4 = ClusterOutput(masses_3)

# ==== cluster Constraint
positions = ClusterInput()
velocities = ClusterInput()
masses = ClusterInput()

# ---- group: States
velocities_2 = Vector(velocities)
positions_2 = Point(positions)
masses_2 = Number(masses)

# ---- group: Force Z >= 0
deconstruct = Deconstruct(Point=positions_2)  # -> XComponent, YComponent, ZComponent
larger_than = LargerThan(FirstNumber=deconstruct.ZComponent, SecondNumber="0")  # -> LargerThan, OrEqualTo
integer = Integer(larger_than.LargerThan)
multiplication = Multiplication(A=deconstruct.ZComponent, B=integer)
construct_point = ConstructPoint(XCoordinate=deconstruct.XComponent, YCoordinate=deconstruct.YComponent, ZCoordinate=multiplication)

# ---- group: Flip V.Z on Collision
expression = Expression(bit=integer, Expression="2 * bit - 1")
deconstruct_vector = DeconstructVector(Vector=velocities_2)  # -> XComponent, YComponent, ZComponent
multiplication_2 = Multiplication(A=deconstruct_vector.ZComponent, B=expression)
vector_xyz = VectorXYZ(XComponent=deconstruct_vector.XComponent, YComponent=deconstruct_vector.YComponent, ZComponent=multiplication_2)  # -> Vector, Length

# ---- group: States
velocities_3 = Vector(vector_xyz.Vector)
positions_3 = Point(construct_point)
masses_3 = Number(masses_2)

# ---- group: Enable / Disable Constraints Bypass
debug = BooleanToggle(True)
stream_filter = StreamFilter(Gate=debug, Stream0=positions_2, Stream1=positions_3)
stream_filter_2 = StreamFilter(Gate=debug, Stream0=velocities_2, Stream1=velocities_3)
stream_filter_3 = StreamFilter(Gate=debug, Stream0=masses_2, Stream1=masses_3)

# ---- group: States
velocities_4 = Vector(stream_filter_2)
positions_4 = Point(stream_filter)
masses_4 = Number(stream_filter_3)

# ----
velocities_5 = ClusterOutput(velocities_4)
masses_5 = ClusterOutput(masses_4)
positions_5 = ClusterOutput(positions_4)

# ==== cluster Display
positions = ClusterInput()
velocities = ClusterInput()
masses = ClusterInput()
forces = ClusterInput()

# ---- group: State
velocities_2 = Vector(velocities)
positions_2 = Point(positions)
masses_2 = Number(masses)

# ----
forces_2 = Vector(forces)

# ---- group: Force Visualization
unit_vector = UnitVector(Vector=forces_2)
multiplication = Multiplication(A=unit_vector, B=Slider(5, range=0..100))
vector_display_ex = VectorDisplayEx(Point=positions_2, Vector=multiplication, Colour=ColourSwatch(SwatchColor=RGB(168, 222, 53)), Width=2)

# ---- group: Velocity Visualization
unit_vector_2 = UnitVector(Vector=velocities_2)
multiplication_2 = Multiplication(A=unit_vector_2, B=Slider(5, range=0..100))
vector_display_ex_2 = VectorDisplayEx(Point=positions_2, Vector=multiplication_2, Colour=ColourSwatch(SwatchColor=RGB(173, 0, 0)), Width=5)

# ---- group: Body Visualization
scale = Slider(0.05, range=0..1)
multiplication_3 = Multiplication(A=masses_2, B=scale)
mesh_sphere = MeshSphere(Base=positions_2, Radius=multiplication_3, UCount=4, VCount=4)

# ---- group: Trajectory Visualization
data_recorder = DataRecorder(positions_2, DataLimit=256, RecordData=True)
list_length = ListLength(List=positions_2)
partition_list = PartitionList(List=data_recorder, Size=list_length)
flip_matrix = FlipMatrix(Data=partition_list)
nurbs_curve = NurbsCurve(Vertices=flip_matrix, Degree=3, Periodic=False)  # -> flatten(Curve), Length, Domain
custom_preview = CustomPreview(Geometry=nurbs_curve.Curve, Material=ColourSwatch(SwatchColor=RGB(233, 240, 36)))

# ==== cluster Control
reset = ClusterInput()
update = ClusterInput()
initial = ClusterInput()
reset_2 = Boolean(reset)
initial_2 = Text(initial)
update_2 = Boolean(update)
gate_or = GateOr(A=reset_2, B=update_2)
load = GhPythonScript(push=gate_or)  # -> data
# ---------- load: Python ----------
import Rhino
data = Rhino.RhinoDoc.ActiveDoc.Notes
# ---------- end load ----------
stream_filter = StreamFilter(Gate=reset_2, Stream0=load, Stream1=initial_2)
unpack = Unpack(text=stream_filter)  # -> positions_2, velocities_2, masses_2
positions = ClusterOutput(unpack.positions_2)
velocities = ClusterOutput(unpack.velocities_2)
masses = ClusterOutput(unpack.masses_2)

# ==== cluster Persist
positions = ClusterInput()
velocities = ClusterInput()
masses = ClusterInput()
pack = Pack(positions=positions, velocities=velocities, masses=masses)
save = GhPythonScript(data=pack)  # -> data
# ---------- save: Python ----------
import Rhino
Rhino.RhinoDoc.ActiveDoc.Notes = data
# ---------- end save ----------

# ==== cluster Pack
positions = ClusterInput()
velocities = ClusterInput()
masses = ClusterInput()

# ---- group: States
positions_2 = Point(positions)
velocities_2 = Vector(velocities)
masses_2 = Number(masses)

# ----
deconstruct_vector = DeconstructVector(Vector=velocities_2)  # -> XComponent, YComponent, ZComponent
deconstruct = Deconstruct(Point=positions_2)  # -> XComponent, YComponent, ZComponent
entwine = Entwine(
    Branch00=deconstruct.XComponent,
    Branch01=deconstruct.YComponent,
    Branch02=deconstruct.ZComponent,
    Branch03=deconstruct_vector.XComponent,
    Branch04=deconstruct_vector.YComponent,
    Branch05=deconstruct_vector.ZComponent,
    Branch06=masses_2,
    FlattenInputs=True)
flip_matrix = FlipMatrix(Data=entwine)
text_join = TextJoin(Text=flip_matrix, Join=" ")  # -> flatten(Result)
text_join_2 = TextJoin(Text=text_join)
result = ClusterOutput(text_join_2)

# ==== cluster Unpack
text = ClusterInput()
text_split = TextSplit(Text=text)
dispatch = Dispatch(List=text_split, DispatchPattern=[True, False])  # -> ListA, ListB
text_split_2 = TextSplit(Text=dispatch.ListA, Separators=" ")
list_item = ListItem(List=text_split_2, Index=0, Wrap=True)  # -> Item, Item1, Item2, Item3, Item4, Item5, Item6
vector_xyz = VectorXYZ(XComponent=list_item.Item3, YComponent=list_item.Item4, ZComponent=list_item.Item5)  # -> Vector, Length
construct_point = ConstructPoint(XCoordinate=list_item.Item, YCoordinate=list_item.Item1, ZCoordinate=list_item.Item2)

# ---- group: States
velocities = Vector(flatten(vector_xyz.Vector))
positions = Point(flatten(construct_point))
masses = Number(flatten(list_item.Item6))

# ----
masses_2 = ClusterOutput(masses)
positions_2 = ClusterOutput(positions)
velocities_2 = ClusterOutput(velocities)
