# Grasshopper definition 3B_Bridge-01.gh (Grasshopper 1.0.7)

number_slider = Slider(4, range=4..64)
curve = Curve(reparameterize(<curve referenced from the Rhino model>))
series = Series(Start=0, Step=expr("1 / ( x - 1)", number_slider), Count=number_slider)
panel = Panel(series)
curve_frame = CurveFrame(Curve=curve, Parameter=series)
deconstruct_plane = DeconstructPlane(Plane=curve_frame)  # -> Origin, XAxis, YAxis, ZAxis
binormal = Vector(deconstruct_plane.ZAxis)
normal = Vector(deconstruct_plane.YAxis)
tangent = Vector(deconstruct_plane.XAxis)
