# Grasshopper definition 3B_Bridge-05.gh (Grasshopper 1.0.7)

number_slider = Slider(10, range=4..64)
cycles = Slider(2.525, range=0..10)
radius = Slider(9.666, range=0..10)
phase = Slider(0.962, range=0..10)
curve = Curve(reparameterize(<curve referenced from the Rhino model>))
series = Series(Start=0, Step=expr("1 / ( x - 1)", number_slider), Count=number_slider)
panel = Panel(series)
curve_frame = CurveFrame(Curve=curve, Parameter=series)
deconstruct_plane = DeconstructPlane(Plane=curve_frame)  # -> Origin, XAxis, YAxis, ZAxis
binormal = Vector(deconstruct_plane.ZAxis)
normal = Vector(deconstruct_plane.YAxis)
tangent = Vector(deconstruct_plane.XAxis)

# ---- group: Points
half_pi = Number(1.570796327)

# ---- group: Points / Points B
multiplication = Multiplication(A=series, B=cycles)
addition = Addition(A=phase, B=half_pi)
addition_2 = Addition(A=multiplication, B=addition)
cosine = Cosine(Value=addition_2)
sine = Sine(Value=addition_2)
multiplication_2 = Multiplication(A=radius, B=cosine)
multiplication_3 = Multiplication(A=radius, B=sine)
multiplication_4 = Multiplication(A=normal, B=multiplication_2)
multiplication_5 = Multiplication(A=binormal, B=multiplication_3)
addition_3 = Addition(A=multiplication_4, B=multiplication_5)
addition_4 = Addition(A=deconstruct_plane.Origin, B=addition_3)

# ---- group: Points / Points A
multiplication_6 = Multiplication(A=series, B=cycles)
addition_5 = Addition(A=multiplication_6, B=phase)
cosine_2 = Cosine(Value=addition_5)
sine_2 = Sine(Value=addition_5)
multiplication_7 = Multiplication(A=radius, B=cosine_2)
multiplication_8 = Multiplication(A=radius, B=sine_2)
multiplication_9 = Multiplication(A=normal, B=multiplication_7)
multiplication_10 = Multiplication(A=binormal, B=multiplication_8)
addition_6 = Addition(A=multiplication_9, B=multiplication_10)
addition_7 = Addition(A=deconstruct_plane.Origin, B=addition_6)

# ---- group: Points / Points C
multiplication_11 = Multiplication(A=series, B=cycles)
addition_8 = Addition(A=addition, B=half_pi)
addition_9 = Addition(A=multiplication_11, B=addition_8)
cosine_3 = Cosine(Value=addition_9)
sine_3 = Sine(Value=addition_9)
multiplication_12 = Multiplication(A=radius, B=cosine_3)
multiplication_13 = Multiplication(A=radius, B=sine_3)
multiplication_14 = Multiplication(A=normal, B=multiplication_12)
multiplication_15 = Multiplication(A=binormal, B=multiplication_13)
addition_10 = Addition(A=multiplication_14, B=multiplication_15)
addition_11 = Addition(A=deconstruct_plane.Origin, B=addition_10)

# ---- group: Points / Points D
multiplication_16 = Multiplication(A=series, B=cycles)
addition_12 = Addition(A=addition_8, B=half_pi)
addition_13 = Addition(A=multiplication_16, B=addition_12)
cosine_4 = Cosine(Value=addition_13)
sine_4 = Sine(Value=addition_13)
multiplication_17 = Multiplication(A=radius, B=cosine_4)
multiplication_18 = Multiplication(A=radius, B=sine_4)
multiplication_19 = Multiplication(A=normal, B=multiplication_17)
multiplication_20 = Multiplication(A=binormal, B=multiplication_18)
addition_14 = Addition(A=multiplication_19, B=multiplication_20)
addition_15 = Addition(A=deconstruct_plane.Origin, B=addition_14)

# ---- group: Beams
polyline = PolyLine(Vertices=addition_7, Closed=False)
polyline_2 = PolyLine(Vertices=addition_4, Closed=False)
polyline_3 = PolyLine(Vertices=addition_11, Closed=False)
polyline_4 = PolyLine(Vertices=addition_15, Closed=False)
line = Line(StartPoint=addition_7, EndPoint=addition_4)
line_2 = Line(StartPoint=addition_4, EndPoint=addition_11)
line_3 = Line(StartPoint=addition_11, EndPoint=addition_15)
line_4 = Line(StartPoint=addition_15, EndPoint=addition_7)
shift_list = ShiftList(List=addition_4, Shift=-1, Wrap=True)
shift_list_2 = ShiftList(List=addition_7, Shift=-1, Wrap=True)
shift_list_3 = ShiftList(List=addition_11, Shift=-1, Wrap=True)
shift_list_4 = ShiftList(List=addition_15, Shift=-1, Wrap=True)
split_list = SplitList(List=addition_11, Index=1)  # -> ListA, ListB
split_list_2 = SplitList(List=shift_list, Index=1)  # -> ListA, ListB
split_list_3 = SplitList(List=addition_4, Index=1)  # -> ListA, ListB
split_list_4 = SplitList(List=shift_list_2, Index=1)  # -> ListA, ListB
split_list_5 = SplitList(List=addition_15, Index=1)  # -> ListA, ListB
split_list_6 = SplitList(List=addition_7, Index=1)  # -> ListA, ListB
split_list_7 = SplitList(List=shift_list_3, Index=1)  # -> ListA, ListB
split_list_8 = SplitList(List=shift_list_4, Index=1)  # -> ListA, ListB
line_5 = Line(StartPoint=split_list_2.ListB, EndPoint=split_list.ListB)
line_6 = Line(StartPoint=split_list_4.ListB, EndPoint=split_list_3.ListB)
line_7 = Line(StartPoint=split_list_7.ListB, EndPoint=split_list_5.ListB)
line_8 = Line(StartPoint=split_list_8.ListB, EndPoint=split_list_6.ListB)
