# Grasshopper definition 4B-Data-Landscapes-02.gh (Grasshopper 1.0.7)

nx = Slider(21, range=2..32)
ny = Slider(16, range=2..32)
series = Series(Start=0, Step=1, Count=nx)
series_2 = Series(Start=0, Step=1, Count=ny)
construct_point = ConstructPoint(XCoordinate=series, YCoordinate=graft(series_2), ZCoordinate=0)
tx = Slider(0, range=-1..1)
ty = Slider(0, range=-1..1)
tz = Slider(0.069, range=-1..1)
sx = Slider(0.625, range=0..1)
sy = Slider(0.108, range=0..1)
sz = Slider(2.077, range=0..5)
deconstruct = Deconstruct(Point=construct_point)  # -> XComponent, YComponent, ZComponent
ghpython_script = GhPythonScript(x=deconstruct.XComponent, y=deconstruct.YComponent, tx=tx, ty=ty, tz=tz, sx=sx, sy=sy, sz=sz)  # -> out, z
# ---------- ghpython_script: Python ----------
from math import *
# added translation control tx, ty, tz
# added scaling control sx, sy, sz
z = sz * sin( ( sx * x + tx ) * ( sy * y + ty ) ) + tz
# ---------- end ghpython_script ----------
construct_point_2 = ConstructPoint(XCoordinate=deconstruct.XComponent, YCoordinate=deconstruct.YComponent, ZCoordinate=ghpython_script.z)
surface_from_points = SurfaceFromPoints(Points=flatten(construct_point_2), UCount=ny, Interpolate=True)
custom_preview = CustomPreview(
    Geometry=surface_from_points,
    Material={diffuse=RGB(221, 160, 221), emission=RGB(66, 48, 66), shine=0.5, specular=RGB(255, 255, 255), transparency=0})
