# Grasshopper definition 4B-Data-Landscapes-03.gh (Grasshopper 1.0.7)

ty = Slider(-0.754, range=-1..1)
tz = Slider(0, range=0..50)
tx = Slider(0, range=-1..1)
sx = Slider(0.136, range=0..1)
sy = Slider(0.246, range=0..1)
sz = Slider(12.368, range=0..20)
thickness = Slider(5, range=0..5)

# ---- group: Height
ny = Slider(100, range=2..100)

# ---- group: Width
nx = Slider(100, range=2..100)

# ----
series = Series(Start=0, Step=1, Count=nx)
series_2 = Series(Start=0, Step=1, Count=ny)
unit_z = UnitZ(Factor=thickness)
construct_point = ConstructPoint(XCoordinate=series, YCoordinate=graft(series_2), ZCoordinate=0)
deconstruct = Deconstruct(Point=construct_point)  # -> XComponent, YComponent, ZComponent
ghpython_script = GhPythonScript(x=deconstruct.XComponent, y=deconstruct.YComponent, tx=tx, ty=ty, tz=tz, sx=sx, sy=sy, sz=sz)  # -> out, z
# ---------- ghpython_script: Python ----------
from math import *
z = sz * ( sin( ( sx * x + tx ) + sin( sy * y + ty ) ) ) + tz
# ---------- end ghpython_script ----------
bounds = Bounds(Numbers=flatten(ghpython_script.z))
deconstruct_domain = DeconstructDomain(Domain=bounds)  # -> Start, End
subtraction = Subtraction(A=deconstruct_domain.End, B=deconstruct_domain.Start)
construct_point_2 = ConstructPoint(XCoordinate=deconstruct.XComponent, YCoordinate=deconstruct.YComponent, ZCoordinate=ghpython_script.z)

# ---- group: Depth
panel = Panel(subtraction)

# ----
surface_from_points = SurfaceFromPoints(Points=flatten(construct_point_2), UCount=ny, Interpolate=True)
extrude = Extrude(Base=surface_from_points, Direction=unit_z)
mesh_brep = MeshBrep(
    Brep=extrude,
    Settings={GridMaxCount=0, GridMinCount=16, JaggedSeams=False, MaxEdgeLength=0, MinEdgeLength=0.0001, MinTolerance=0, Refine=True, RefineAngle=0, RelativeTolerance=0.65, SimplePlanes=True, Tolerance=0})
