# Grasshopper definition 4a-information-nesting.gh (Grasshopper 1.0.7)

number_slider = Slider(4, range=0..10)
number_slider_2 = Slider(4, range=0..10)
series = Series(Start=0, Step=1, Count=10)  # -> graft(Series)
series_2 = Series(Start=0, Step=1, Count=10)

X = Text("X")
Y = Text("Y")
Z = Text("Z")
merge = Merge(Data1=X, Data2=Y, Data3=Z)

_1 = Integer(1)
_2 = Integer(2)
merge_2 = Merge(Data1=_1, Data2=_2)

panel = Panel(series)
division = Division(A="1", B=number_slider_2)
division_2 = Division(A="1", B=number_slider)
addition = Addition(A=series, B=series_2)
concatenate = Concatenate(FragmentA=merge, FragmentB=merge_2)
series_3 = Series(Start=0, Step=division_2, Count=number_slider)
series_4 = Series(Start=0, Step=division, Count=number_slider_2)
panel_2 = Panel(addition)
vector_xyz = VectorXYZ(XComponent=0, YComponent=division, ZComponent=0)  # -> Vector, Length
panel_3 = Panel(concatenate)
vector_xyz_2 = VectorXYZ(XComponent=division_2, YComponent=division, ZComponent=0)  # -> Vector, Length
vector_xyz_3 = VectorXYZ(XComponent=0, YComponent=division, ZComponent=0)  # -> Vector, Length
construct_point = ConstructPoint(XCoordinate=series_3, YCoordinate=graft(series_4), ZCoordinate=0)  # -> flatten(Point)
addition_2 = Addition(A=vector_xyz_3.Vector, B=construct_point)
addition_3 = Addition(A=vector_xyz_2.Vector, B=construct_point)
addition_4 = Addition(A=vector_xyz.Vector, B=construct_point)
_4point_surface = _4PointSurface(CornerA=construct_point, CornerB=addition_3, CornerC=addition_4, CornerD=addition_2)
ghpython_script = GhPythonScript()  # -> out, a
# ---------- ghpython_script: Python ----------
import math

a = x*(math.cos(x) + math.cos(y))
# ---------- end ghpython_script ----------
