# Grasshopper definition ctd-assignment-2.gh (Grasshopper 1.0.7)

size = Slider(1.28, range=1..5)
density = Slider(17, range=1..30)
height = Slider(2.1, range=0..6)
city_center = Slider(2.99, range=0..10)

ghpython_script = GhPythonScript(size=size, density=density, height=height, center=city_center)  # -> out, xarray, yarray, zarray, radius
# ---------- ghpython_script: Python ----------
import rhinoscriptsyntax as rs
import math

## Get points between 0 and pi
max =  size*math.pi
step = (size*math.pi)/density

xarray = []
yarray = []
zarray = []
points = 0

y = 0

while y <= max:
    x = 0
    ## Nested while loop to create a "2d-list", similar to grafting
    while x <= max:
        xarray += [x]
        yarray += [y]
        
        z = height*((math.sin(x + center))*(math.sin(y + center)))**2
        zarray += [z]
        
        x += step
        points += 1
    
    y += step
# ---------- end ghpython_script ----------
construct_point = ConstructPoint(XCoordinate=ghpython_script.xarray, YCoordinate=ghpython_script.yarray, ZCoordinate=0)
construct_point_2 = ConstructPoint(XCoordinate=ghpython_script.xarray, YCoordinate=ghpython_script.yarray, ZCoordinate=ghpython_script.zarray)
circle_cnr = CircleCNR(Center=construct_point, Normal=Vector(0, 0, 1), Radius=0.5)
circle_cnr_2 = CircleCNR(Center=construct_point_2, Normal=Vector(0, 0, 1), Radius=0.3)
cylinder = Cylinder(Base=circle_cnr, Radius=0.3, Length=ghpython_script.zarray)
