# Grasshopper definition idk-man.gh (Grasshopper 1.0.7)

number_slider = Slider(11, range=0..11)
panel = Panel()
subtraction = Subtraction(A=number_slider, B=panel)
series = Series(Start=0, Step=1, Count=number_slider)
division = Division(A=series, B=subtraction)
pt = ConstructPoint(XCoordinate=division, YCoordinate=0, ZCoordinate=0)
panel_2 = Panel(series)
panel_3 = Panel(pt)
