# Grasshopper definition 5B_N-body.gh (Grasshopper 1.0.7)

count = Slider(23, range=2..64)
planets = Planets(count=count)

timer = Timer(Interval=100, TimerInterval=100, Target=reset)  # disabled
reset = Button()
control = Control(reset=reset, initial=planets)  # -> positions, velocities, masses

# ---- group: State
velocities = Vector(control.velocities)
positions = Point(control.positions)
masses = Number(control.masses)

# ----
analysis = Analysis(positions=positions, velocities=velocities, masses=masses)
integrate = Integrate(positions=positions, velocities=velocities, masses=masses, forces=analysis)  # -> positions_4, velocities_4, masses_4
enable = BooleanToggle(True)
constraint = Constraint(positions=integrate.positions_4, velocities=integrate.velocities_4, masses=integrate.masses_4, enable=enable)  # -> positions_4, velocities_4, masses_4

display = Display(positions=control.positions, velocities=control.velocities, masses=control.masses, forces=analysis)
persist = Persist(positions=constraint.positions_4, velocities=constraint.velocities_4, masses=constraint.masses_4)

# ==== cluster Planets
count = ClusterInput()
count_2 = Integer(count)
domain_box = DomainBox(Base=PlaneXY(0, 0, 0), X="-10 To 10", Y="-10 To 10", Z="-10 To 10")
populate_3d = Populate3D(Region=domain_box, Count=count_2, Seed=1)
random = Random(Range="100 To 300", Number=count_2, Seed=2)
multiplication = Multiplication(A=populate_3d, B="0")
vector = Vector(multiplication)

# ---- group: States
velocities = Vector(vector)
masses = Number(random)
positions = Point(populate_3d)

# ----
pack = Pack(positions=positions, velocities=velocities, masses=masses)
packed = Text(pack)
packed_2 = ClusterOutput(packed)

# ==== cluster Analysis
velocities = ClusterInput()
positions = ClusterInput()
masses = ClusterInput()

# ---- group: States
velocities_2 = Vector(velocities)
positions_2 = Point(positions)
masses_2 = Number(masses)

# ---- group: Force Analysis
subtraction = Subtraction(A=positions_2, B=graft(positions_2))
dot_product = DotProduct(VectorA=subtraction, VectorB=subtraction, Unitize=False)
unit_vector = UnitVector(Vector=subtraction)
multiplication = Multiplication(A=masses_2, B=graft(masses_2))
_1_a = GhPythonScript(A=dot_product)  # -> B
# ---------- _1_a: Python ----------
B = 0 if A == 0 else 1 / A
# ---------- end _1_a ----------
G = Slider(1, range=0..1000)
multiplication_2 = Multiplication(A=_1_a, B=multiplication)
multiplication_3 = Multiplication(A=multiplication_2, B=G)
multiplication_4 = Multiplication(A=unit_vector, B=multiplication_3)
mass_addition = MassAddition(Input=multiplication_4)  # -> flatten(Result), PartialResults

# ---- group: Drag
k = Slider(0, range=0..10)
multiplication_5 = Multiplication(A=velocities_2, B=k)
negative = Negative(Value=multiplication_5)

# ----
addition = Addition(A=mass_addition.Result, B=negative)
sumforces = Vector(addition)
sumforces_2 = ClusterOutput(sumforces)

# ==== cluster Integrate
positions = ClusterInput()
velocities = ClusterInput()
masses = ClusterInput()
forces = ClusterInput()

# ---- group: State
velocities_2 = Vector(velocities)
positions_2 = Point(positions)
masses_2 = Number(masses)

# ----
forces_2 = Vector(forces)

# ---- group: Time Step
dt = Slider(0.05, range=0.001..0.1)

# ---- group: Acceleration
a_b = GhPythonScript(A=forces_2, B=masses_2)  # -> C
# ---------- a_b: Python ----------
C = 0 * A if B == 0 else A / B
# ---------- end a_b ----------

# ---- group: Acceleration * dt
multiplication = Multiplication(A=a_b, B=dt)

# ---- group: Velocity += Acceleration * dt
addition = Addition(A=multiplication, B=velocities_2)

# ---- group: Velocity * dt
multiplication_2 = Multiplication(A=addition, B=dt)

# ---- group: Position += Velocity * dt
addition_2 = Addition(A=multiplication_2, B=positions_2)

# ---- group: States
positions_3 = Point(addition_2)
velocities_3 = Vector(addition)
masses_3 = Number(masses_2)

# ----
positions_4 = ClusterOutput(positions_3)
velocities_4 = ClusterOutput(velocities_3)
masses_4 = ClusterOutput(masses_3)

# ==== cluster Constraint
velocities = ClusterInput()
positions = ClusterInput()
masses = ClusterInput()
enable = ClusterInput()

# ---- group: State
velocities_2 = Vector(velocities)
positions_2 = Point(positions)
masses_2 = Number(masses)

# ----
enable_2 = Boolean(enable)
world = World(positions=positions, velocities=velocities_2, limit="25", enable=enable_2)  # -> positions_4, velocities_4
bounds = Bounds(limit="25", enable=enable_2)

# ---- group: State
positions_3 = Point(world.positions_4)
velocities_3 = Vector(world.velocities_4)
masses_3 = Number(masses_2)

# ----
positions_4 = ClusterOutput(positions_3)
velocities_4 = ClusterOutput(velocities_3)
masses_4 = ClusterOutput(masses_3)

# ==== cluster Display
positions = ClusterInput()
velocities = ClusterInput()
masses = ClusterInput()
forces = ClusterInput()

# ---- group: State
velocities_2 = Vector(velocities)
positions_2 = Point(positions)
masses_2 = Number(masses)

# ----
forces_2 = Vector(forces)

# ---- group: Force Visualization
unit_vector = UnitVector(Vector=forces_2)
multiplication = Multiplication(A=unit_vector, B=Slider(5, range=0..100))
vector_display_ex = VectorDisplayEx(Point=positions_2, Vector=multiplication, Colour=ColourSwatch(SwatchColor=RGB(168, 222, 53)), Width=2)

# ---- group: Velocity Visualization
unit_vector_2 = UnitVector(Vector=velocities_2)
multiplication_2 = Multiplication(A=unit_vector_2, B=Slider(5, range=0..100))
vector_display_ex_2 = VectorDisplayEx(Point=positions_2, Vector=multiplication_2, Colour=ColourSwatch(SwatchColor=RGB(173, 0, 0)), Width=5)

# ---- group: Body Visualization
scale = Slider(0.1, range=0..5)
cube_root = CubeRoot(Value=masses_2)
multiplication_3 = Multiplication(A=cube_root, B=scale)
mesh_sphere = MeshSphere(Base=positions_2, Radius=multiplication_3, UCount=16, VCount=16)

# ---- group: Trajectory Visualization
enabled = BooleanToggle(True)
stream_gate = StreamGate(Stream=positions_2, Gate=enabled)  # -> Target0, Target1
data_recorder = DataRecorder(stream_gate.Target1, DataLimit=256, RecordData=True)
list_length = ListLength(List=stream_gate.Target1)
partition_list = PartitionList(List=data_recorder, Size=list_length)
flip_matrix = FlipMatrix(Data=partition_list)

# ----
nurbs_curve = NurbsCurve(Vertices=flip_matrix, Degree=3, Periodic=False)  # -> flatten(Curve), Length, Domain

# ---- group: Trajectory Visualization (continued)
custom_preview = CustomPreview(Geometry=nurbs_curve.Curve, Material=ColourSwatch(SwatchColor=RGB(233, 240, 36)))

# ==== cluster Control
reset = ClusterInput()
initial = ClusterInput()
reset_2 = Boolean(reset)
initial_2 = Text(initial)
load = GhPythonScript(push=reset_2)  # -> data
# ---------- load: Python ----------
import Rhino
data = Rhino.RhinoDoc.ActiveDoc.Notes
# ---------- end load ----------
stream_filter = StreamFilter(Gate=reset_2, Stream0=load, Stream1=initial_2)
unpack = Unpack(text=stream_filter)  # -> positions_2, velocities_2, masses_2
positions = ClusterOutput(unpack.positions_2)
velocities = ClusterOutput(unpack.velocities_2)
masses = ClusterOutput(unpack.masses_2)

# ==== cluster Persist
positions = ClusterInput()
velocities = ClusterInput()
masses = ClusterInput()
pack = Pack(positions=positions, velocities=velocities, masses=masses)
save = GhPythonScript(data=pack)  # -> data
# ---------- save: Python ----------
import Rhino
Rhino.RhinoDoc.ActiveDoc.Notes = data
# ---------- end save ----------

# ==== cluster Pack
positions = ClusterInput()
velocities = ClusterInput()
masses = ClusterInput()

# ---- group: States
positions_2 = Point(positions)
velocities_2 = Vector(velocities)
masses_2 = Number(masses)

# ----
deconstruct_vector = DeconstructVector(Vector=velocities_2)  # -> XComponent, YComponent, ZComponent
deconstruct = Deconstruct(Point=positions_2)  # -> XComponent, YComponent, ZComponent
entwine = Entwine(
    Branch00=deconstruct.XComponent,
    Branch01=deconstruct.YComponent,
    Branch02=deconstruct.ZComponent,
    Branch03=deconstruct_vector.XComponent,
    Branch04=deconstruct_vector.YComponent,
    Branch05=deconstruct_vector.ZComponent,
    Branch06=masses_2,
    FlattenInputs=True)
flip_matrix = FlipMatrix(Data=entwine)
text_join = TextJoin(Text=flip_matrix, Join=",")  # -> flatten(Result)
text_join_2 = TextJoin(Text=text_join, Join=";")
result = ClusterOutput(text_join_2)

# ==== cluster Bounds
enable = ClusterInput()
limit = ClusterInput()
enable_2 = Boolean(enable)
limit_2 = Number(limit)
stream_gate = StreamGate(Stream=limit_2, Gate=enable_2)  # -> Target0, Target1
negative = Negative(Value=stream_gate.Target1)
construct_domain = ConstructDomain(DomainStart=negative, DomainEnd=stream_gate.Target1)
domain_box = DomainBox(Base=PlaneXY(0, 0, 0), X=construct_domain, Y=construct_domain, Z=construct_domain)
custom_preview = CustomPreview(Geometry=domain_box, Material=ColourSwatch(SwatchColor=RGBA(186, 187, 255, 0)))

# ==== cluster World
limit = ClusterInput()
enable = ClusterInput()
velocities = ClusterInput()
positions = ClusterInput()
velocities_2 = Vector(velocities)
positions_2 = Point(positions)
bounce = Bounce(positions=positions_2, velocities=velocities_2, limit=limit)  # -> positions_4, velocities_4
enable_2 = Boolean(enable)
stream_filter = StreamFilter(Gate=enable_2, Stream0=velocities_2, Stream1=bounce.velocities_4)
stream_filter_2 = StreamFilter(Gate=enable_2, Stream0=positions_2, Stream1=bounce.positions_4)
positions_3 = Point(stream_filter_2)
velocities_3 = Vector(stream_filter)
positions_4 = ClusterOutput(positions_3)
velocities_4 = ClusterOutput(velocities_3)

# ==== cluster Unpack
text = ClusterInput()
text_split = TextSplit(Text=text, Separators=";")
text_split_2 = TextSplit(Text=text_split, Separators=",")
list_item = ListItem(List=text_split_2, Index=0, Wrap=True)  # -> Item, Item1, Item2, Item3, Item4, Item5, Item6
vector_xyz = VectorXYZ(XComponent=list_item.Item3, YComponent=list_item.Item4, ZComponent=list_item.Item5)  # -> Vector, Length
construct_point = ConstructPoint(XCoordinate=list_item.Item, YCoordinate=list_item.Item1, ZCoordinate=list_item.Item2)

# ---- group: States
velocities = Vector(flatten(vector_xyz.Vector))
positions = Point(flatten(construct_point))
masses = Number(flatten(list_item.Item6))

# ----
masses_2 = ClusterOutput(masses)
positions_2 = ClusterOutput(positions)
velocities_2 = ClusterOutput(velocities)

# ==== cluster Bounce
velocities = ClusterInput()
positions = ClusterInput()
limit = ClusterInput()
positions_2 = Point(positions)
velocities_2 = Vector(velocities)
deconstruct_vector = DeconstructVector(Vector=velocities_2)  # -> XComponent, YComponent, ZComponent
deconstruct = Deconstruct(Point=positions_2)  # -> XComponent, YComponent, ZComponent
limit_2 = Number(limit)
clamp = GhPythonScript(Coordinate=deconstruct.YComponent, Component=deconstruct_vector.YComponent, Limit=limit_2)  # -> NewCoordinate, NewComponent
# ---------- clamp: Python ----------
NewCoordinate = -Limit if( Coordinate < -Limit ) else Limit if( Coordinate > Limit ) else Coordinate
NewComponent  = -Component if( Coordinate < -Limit or Coordinate > Limit ) else Component
# ---------- end clamp ----------
clamp_2 = GhPythonScript(Coordinate=deconstruct.XComponent, Component=deconstruct_vector.XComponent, Limit=limit_2)  # -> NewCoordinate, NewComponent; same code as clamp
clamp_3 = GhPythonScript(Coordinate=deconstruct.ZComponent, Component=deconstruct_vector.ZComponent, Limit=limit_2)  # -> NewCoordinate, NewComponent; same code as clamp
construct_point = ConstructPoint(XCoordinate=clamp_2.NewCoordinate, YCoordinate=clamp.NewCoordinate, ZCoordinate=clamp_3.NewCoordinate)
vector_xyz = VectorXYZ(XComponent=clamp_2.NewComponent, YComponent=clamp.NewComponent, ZComponent=clamp_3.NewComponent)  # -> Vector, Length
positions_3 = Point(construct_point)
velocities_3 = Vector(vector_xyz.Vector)
positions_4 = ClusterOutput(positions_3)
velocities_4 = ClusterOutput(velocities_3)
