# Grasshopper definition 5B_SpatialGraph.gh (Grasshopper 1.0.7)

count = Slider(6, range=2..64)
spring = Spring(count=count)

timer = Timer(Interval=100, TimerInterval=100, Target=reset)
reset = Button()
control = Control(reset=reset, initial=spring)  # -> positions, velocities, masses

# ---- group: State
velocities = Vector(control.velocities)
positions = Point(control.positions)
masses = Number(control.masses)

# ----
analysis = Analysis(positions=positions, velocities=velocities, masses=masses)
integrate = Integrate(positions=positions, velocities=velocities, masses=masses, forces=analysis)  # -> positions_4, velocities_4, masses_4
enable = BooleanToggle(False)
constraint = Constraint(positions=integrate.positions_4, velocities=integrate.velocities_4, masses=integrate.masses_4, enable=enable)  # -> positions_4, velocities_4, masses_4

display = Display(positions=control.positions, velocities=control.velocities, masses=control.masses, forces=analysis)
persist = Persist(positions=constraint.positions_4, velocities=constraint.velocities_4, masses=constraint.masses_4)

# ==== cluster Analysis
velocities = ClusterInput()
positions = ClusterInput()
masses = ClusterInput()

# ---- group: State
velocities_2 = Vector(velocities)
positions_2 = Point(positions)
masses_2 = Number(masses)

# ---- group: Forces
L = Slider(10, range=0..100)
k = Slider(10, range=0..100)
g = Slider(0, range=0..10)
k_2 = Slider(1, range=0..10)
gravity = Gravity(acceleration=g, mass=masses_2)
springs = Springs(positions=positions_2, rest_length=L, stiffness=k)
drag = Drag(velocity=velocities_2, factor=k_2)

# ---- group: Sumation
addition = Addition(A=springs, B=drag)
addition_2 = Addition(A=addition, B=gravity)
sumforces = Vector(addition_2)

# ----
sumforces_2 = ClusterOutput(sumforces)

# ==== cluster Integrate
positions = ClusterInput()
velocities = ClusterInput()
masses = ClusterInput()
forces = ClusterInput()
forces_2 = Vector(forces)

# ---- group: State
velocities_2 = Vector(velocities)
positions_2 = Point(positions)
masses_2 = Number(masses)

# ---- group: Time Step
dt = Slider(0.05, range=0.001..0.1)

# ---- group: Acceleration
a_b = GhPythonScript(A=forces_2, B=masses_2)  # -> C
# ---------- a_b: Python ----------
C = 0 * A if B == 0 else A / B
# ---------- end a_b ----------

# ---- group: Acceleration * dt
multiplication = Multiplication(A=a_b, B=dt)

# ---- group: Velocity += Acceleration * dt
addition = Addition(A=multiplication, B=velocities_2)

# ---- group: Velocity * dt
multiplication_2 = Multiplication(A=addition, B=dt)

# ---- group: Position += Velocity * dt
addition_2 = Addition(A=multiplication_2, B=positions_2)

# ---- group: States
positions_3 = Point(addition_2)
velocities_3 = Vector(addition)
masses_3 = Number(masses_2)

# ----
positions_4 = ClusterOutput(positions_3)
velocities_4 = ClusterOutput(velocities_3)
masses_4 = ClusterOutput(masses_3)

# ==== cluster Display
positions = ClusterInput()
velocities = ClusterInput()
masses = ClusterInput()
forces = ClusterInput()

# ---- group: State
velocities_2 = Vector(velocities)
positions_2 = Point(positions)
masses_2 = Number(masses)

# ----
forces_2 = Vector(forces)
line = Line(StartPoint=positions_2, EndPoint=graft(positions_2))

# ---- group: Velocity Visualization
scale = Slider(0.05, range=0..100)
multiplication = Multiplication(A=velocities_2, B=scale)
vector_display_ex = VectorDisplayEx(Point=positions_2, Vector=multiplication, Colour=ColourSwatch(SwatchColor=RGB(255, 71, 71)), Width=5)

# ---- group: Force Visualization
scale_2 = Slider(0.005, range=0..100)
multiplication_2 = Multiplication(A=forces_2, B=scale_2)
vector_display_ex_2 = VectorDisplayEx(Point=positions_2, Vector=multiplication_2, Colour=ColourSwatch(SwatchColor=RGB(168, 222, 53)), Width=5)

# ---- group: Trajectory Visualization
data_recorder = DataRecorder(positions_2, DataLimit=256, RecordData=False)
list_length = ListLength(List=positions_2)
partition_list = PartitionList(List=data_recorder, Size=list_length)
flip_matrix = FlipMatrix(Data=partition_list)

# ----
nurbs_curve = NurbsCurve(Vertices=flip_matrix, Degree=3, Periodic=False)  # -> flatten(Curve), Length, Domain

# ---- group: Trajectory Visualization (continued)
custom_preview = CustomPreview(Geometry=nurbs_curve.Curve, Material=ColourSwatch(SwatchColor=RGB(233, 240, 36)))

# ==== cluster Control
reset = ClusterInput()
initial = ClusterInput()
reset_2 = Boolean(reset)
initial_2 = Text(initial)
load = GhPythonScript(push=reset_2)  # -> data
# ---------- load: Python ----------
import Rhino
data = Rhino.RhinoDoc.ActiveDoc.Notes
# ---------- end load ----------
stream_filter = StreamFilter(Gate=reset_2, Stream0=load, Stream1=initial_2)
unpack = Unpack(text=stream_filter)  # -> positions_2, velocities_2, masses_2
positions = ClusterOutput(unpack.positions_2)
velocities = ClusterOutput(unpack.velocities_2)
masses = ClusterOutput(unpack.masses_2)

# ==== cluster Persist
positions = ClusterInput()
velocities = ClusterInput()
masses = ClusterInput()
pack = Pack(positions=positions, velocities=velocities, masses=masses)
save = GhPythonScript(data=pack)  # -> data
# ---------- save: Python ----------
import Rhino
Rhino.RhinoDoc.ActiveDoc.Notes = data
# ---------- end save ----------

# ==== cluster Spring
count = ClusterInput()
count_2 = Integer(count)
populate_2d = Populate2D(Region={Plane=PlaneXY(0, 0, 0), Size=Domain2(u=0..20, v=0..10)}, Count=count_2, Seed=1)
number = Number("1")
duplicate_data = DuplicateData(Data=number, Number=count_2, Order=True)
multiplication = Multiplication(A="0", B=populate_2d)

# ---- group: States
velocities = Vector(multiplication)
masses = Number(duplicate_data)
positions = Point(populate_2d)

# ----
pack = Pack_2(positions=positions, velocities=velocities, masses=masses)
packed = Text(pack)
packed_2 = ClusterOutput(packed)

# ==== cluster Constraint
velocities = ClusterInput()
positions = ClusterInput()
masses = ClusterInput()
enable = ClusterInput()

# ---- group: State
velocities_2 = Vector(velocities)
positions_2 = Point(positions)
masses_2 = Number(masses)

# ----
enable_2 = Boolean(enable)
world = World(positions=positions, velocities=velocities_2, limit="25", enable=enable_2)  # -> positions_4, velocities_4
bounds = Bounds(limit="25", enable=enable_2)

# ---- group: State
positions_3 = Point(world.positions_4)
velocities_3 = Vector(world.velocities_4)
masses_3 = Number(masses_2)

# ----
positions_4 = ClusterOutput(positions_3)
velocities_4 = ClusterOutput(velocities_3)
masses_4 = ClusterOutput(masses_3)

# ==== cluster Gravity
mass = ClusterInput()
acceleration = ClusterInput()
mass_2 = Number(mass)
acceleration_2 = Number(acceleration)
unit_z = UnitZ(Factor=acceleration_2)
negative = Negative(Value=unit_z)
multiplication = Multiplication(A=negative, B=mass_2)
force = Vector(multiplication)
force_2 = ClusterOutput(force)

# ==== cluster Drag
velocity = ClusterInput()
factor = ClusterInput()
velocity_2 = Vector(velocity)
factor_2 = Number(factor)
multiplication = Multiplication(A=velocity_2, B=factor_2)
negative = Negative(Value=multiplication)
force = Vector(negative)
force_2 = ClusterOutput(force)

# ==== cluster Springs
positions = ClusterInput()
rest_length = ClusterInput()
stiffness = ClusterInput()
positions_2 = Point(positions)
rest_length_2 = Number(rest_length)
stiffness_2 = Number(stiffness)

# ---- group: Forces
vector_2pt = Vector2Pt(PointA=positions_2, PointB=graft(positions_2), Unitize=False)  # -> Vector, Length
subtraction = Subtraction(A=rest_length_2, B=vector_2pt.Length)
unit_vector = UnitVector(Vector=vector_2pt.Vector)
multiplication = Multiplication(A=subtraction, B=stiffness_2)
multiplication_2 = Multiplication(A=unit_vector, B=multiplication)
mass_addition = MassAddition(Input=multiplication_2)  # -> flatten(Result), PartialResults

# ----
force = Vector(mass_addition.Result)
force_2 = ClusterOutput(force)

# ==== cluster Unpack
text = ClusterInput()
text_split = TextSplit(Text=text, Separators=";")
text_split_2 = TextSplit(Text=text_split, Separators=",")
list_item = ListItem(List=text_split_2, Index=0, Wrap=True)  # -> Item, Item1, Item2, Item3, Item4, Item5, Item6
vector_xyz = VectorXYZ(XComponent=list_item.Item3, YComponent=list_item.Item4, ZComponent=list_item.Item5)  # -> Vector, Length
construct_point = ConstructPoint(XCoordinate=list_item.Item, YCoordinate=list_item.Item1, ZCoordinate=list_item.Item2)

# ---- group: States
velocities = Vector(flatten(vector_xyz.Vector))
positions = Point(flatten(construct_point))
masses = Number(flatten(list_item.Item6))

# ----
masses_2 = ClusterOutput(masses)
positions_2 = ClusterOutput(positions)
velocities_2 = ClusterOutput(velocities)

# ==== cluster Pack
positions = ClusterInput()
velocities = ClusterInput()
masses = ClusterInput()

# ---- group: State
positions_2 = Point(positions)
velocities_2 = Vector(velocities)
masses_2 = Number(masses)

# ----
deconstruct_vector = DeconstructVector(Vector=velocities_2)  # -> XComponent, YComponent, ZComponent
deconstruct = Deconstruct(Point=positions_2)  # -> XComponent, YComponent, ZComponent
entwine = Entwine(
    Branch00=deconstruct.XComponent,
    Branch01=deconstruct.YComponent,
    Branch02=deconstruct.ZComponent,
    Branch03=deconstruct_vector.XComponent,
    Branch04=deconstruct_vector.YComponent,
    Branch05=deconstruct_vector.ZComponent,
    Branch06=masses_2,
    FlattenInputs=True)
flip_matrix = FlipMatrix(Data=entwine)
text_join = TextJoin(Text=flip_matrix, Join=",")  # -> flatten(Result)
text_join_2 = TextJoin(Text=text_join, Join=";")
result = ClusterOutput(text_join_2)

# ==== cluster Pack_2
positions = ClusterInput()
velocities = ClusterInput()
masses = ClusterInput()

# ---- group: States
positions_2 = Point(positions)
velocities_2 = Vector(velocities)
masses_2 = Number(masses)

# ----
deconstruct_vector = DeconstructVector(Vector=velocities_2)  # -> XComponent, YComponent, ZComponent
deconstruct = Deconstruct(Point=positions_2)  # -> XComponent, YComponent, ZComponent
entwine = Entwine(
    Branch00=deconstruct.XComponent,
    Branch01=deconstruct.YComponent,
    Branch02=deconstruct.ZComponent,
    Branch03=deconstruct_vector.XComponent,
    Branch04=deconstruct_vector.YComponent,
    Branch05=deconstruct_vector.ZComponent,
    Branch06=masses_2,
    FlattenInputs=True)
flip_matrix = FlipMatrix(Data=entwine)
text_join = TextJoin(Text=flip_matrix, Join=",")  # -> flatten(Result)
text_join_2 = TextJoin(Text=text_join, Join=";")
result = ClusterOutput(text_join_2)

# ==== cluster Bounds
enable = ClusterInput()
limit = ClusterInput()
enable_2 = Boolean(enable)
limit_2 = Number(limit)
stream_gate = StreamGate(Stream=limit_2, Gate=enable_2)  # -> Target0, Target1
negative = Negative(Value=stream_gate.Target1)
construct_domain = ConstructDomain(DomainStart=negative, DomainEnd=stream_gate.Target1)
domain_box = DomainBox(Base=PlaneXY(0, 0, 0), X=construct_domain, Y=construct_domain, Z=construct_domain)
custom_preview = CustomPreview(Geometry=domain_box, Material=ColourSwatch(SwatchColor=RGBA(186, 187, 255, 0)))

# ==== cluster World
limit = ClusterInput()
enable = ClusterInput()
velocities = ClusterInput()
positions = ClusterInput()
velocities_2 = Vector(velocities)
positions_2 = Point(positions)
bounce = Bounce(positions=positions_2, velocities=velocities_2, limit=limit)  # -> positions_4, velocities_4
enable_2 = Boolean(enable)
stream_filter = StreamFilter(Gate=enable_2, Stream0=velocities_2, Stream1=bounce.velocities_4)
stream_filter_2 = StreamFilter(Gate=enable_2, Stream0=positions_2, Stream1=bounce.positions_4)
positions_3 = Point(stream_filter_2)
velocities_3 = Vector(stream_filter)
positions_4 = ClusterOutput(positions_3)
velocities_4 = ClusterOutput(velocities_3)

# ==== cluster Bounce
velocities = ClusterInput()
positions = ClusterInput()
limit = ClusterInput()
positions_2 = Point(positions)
velocities_2 = Vector(velocities)
deconstruct_vector = DeconstructVector(Vector=velocities_2)  # -> XComponent, YComponent, ZComponent
deconstruct = Deconstruct(Point=positions_2)  # -> XComponent, YComponent, ZComponent
limit_2 = Number(limit)
clamp = GhPythonScript(Coordinate=deconstruct.YComponent, Component=deconstruct_vector.YComponent, Limit=limit_2)  # -> NewCoordinate, NewComponent
# ---------- clamp: Python ----------
NewCoordinate = -Limit if( Coordinate < -Limit ) else Limit if( Coordinate > Limit ) else Coordinate
NewComponent  = -Component if( Coordinate < -Limit or Coordinate > Limit ) else Component
# ---------- end clamp ----------
clamp_2 = GhPythonScript(Coordinate=deconstruct.XComponent, Component=deconstruct_vector.XComponent, Limit=limit_2)  # -> NewCoordinate, NewComponent; same code as clamp
clamp_3 = GhPythonScript(Coordinate=deconstruct.ZComponent, Component=deconstruct_vector.ZComponent, Limit=limit_2)  # -> NewCoordinate, NewComponent; same code as clamp
construct_point = ConstructPoint(XCoordinate=clamp_2.NewCoordinate, YCoordinate=clamp.NewCoordinate, ZCoordinate=clamp_3.NewCoordinate)
vector_xyz = VectorXYZ(XComponent=clamp_2.NewComponent, YComponent=clamp.NewComponent, ZComponent=clamp_3.NewComponent)  # -> Vector, Length
positions_3 = Point(construct_point)
velocities_3 = Vector(vector_xyz.Vector)
positions_4 = ClusterOutput(positions_3)
velocities_4 = ClusterOutput(velocities_3)
