# Grasshopper definition 6A_Vaults.gh (Grasshopper 1.0.7)

nx = Slider(5, range=2..32)
ny = Slider(5, range=2..32)
m = Slider(1, range=0..1)
sheet = Sheet(count_x=nx, count_y=ny, mass=m)  # -> initial_2, faces_2, edges_2

timer = Timer(Interval=100, TimerInterval=100, Target=reset)  # disabled
reset = Button()
control = Control(reset=reset, initial=sheet.initial_2)  # -> positions, velocities, masses

# ---- group: State
velocities = Vector(control.velocities)
positions = Point(control.positions)
masses = Number(control.masses)

# ----
analysis = Analysis(positions=positions, velocities=velocities, masses=masses, edges=sheet.edges_2)
integrate = Integrate(positions=positions, velocities=velocities, masses=masses, forces=analysis)  # -> positions_4, velocities_4, masses_4
enable = BooleanToggle(False)
constraint = Constraint(positions=integrate.positions_4, velocities=integrate.velocities_4, masses=integrate.masses_4, enable=enable)  # -> positions_5, velocities_5, masses_5

display = Display(positions=control.positions, velocities=control.velocities, masses=control.masses, forces=analysis, faces=sheet.faces_2)
persist = Persist(positions=constraint.positions_5, velocities=constraint.velocities_5, masses=constraint.masses_5)

# ==== cluster Integrate
positions = ClusterInput()
velocities = ClusterInput()
masses = ClusterInput()
forces = ClusterInput()
forces_2 = Vector(forces)

# ---- group: State
velocities_2 = Vector(velocities)
positions_2 = Point(positions)
masses_2 = Number(masses)

# ---- group: Time Step
dt = Slider(0.05, range=0.001..0.1)

# ---- group: Acceleration
a_b = GhPythonScript(A=forces_2, B=masses_2)  # -> C
# ---------- a_b: Python ----------
C = 0 * A if B == 0 else A / B
# ---------- end a_b ----------

# ---- group: Acceleration * dt
multiplication = Multiplication(A=a_b, B=dt)

# ---- group: Velocity += Acceleration * dt
addition = Addition(A=multiplication, B=velocities_2)

# ---- group: Velocity * dt
multiplication_2 = Multiplication(A=addition, B=dt)

# ---- group: Position += Velocity * dt
addition_2 = Addition(A=multiplication_2, B=positions_2)

# ---- group: States
positions_3 = Point(addition_2)
velocities_3 = Vector(addition)
masses_3 = Number(masses_2)

# ----
positions_4 = ClusterOutput(positions_3)
velocities_4 = ClusterOutput(velocities_3)
masses_4 = ClusterOutput(masses_3)

# ==== cluster Constraint
positions = ClusterInput()
velocities = ClusterInput()
masses = ClusterInput()
enable = ClusterInput()

# ---- group: States
velocities_2 = Vector(velocities)
positions_2 = Point(positions)
masses_2 = Number(masses)

# ----
enable_2 = Boolean(enable)
deconstruct_vector = DeconstructVector(Vector=velocities_2)  # -> XComponent, YComponent, ZComponent
deconstruct = Deconstruct(Point=positions_2)  # -> XComponent, YComponent, ZComponent
limit = Number("25")
clamp = GhPythonScript(Value=deconstruct.XComponent, Limit=limit)  # -> Clamped, Reverse
# ---------- clamp: Python ----------
Clamped = -Limit if( Value < -Limit ) else Limit if( Value > Limit ) else Value
Reverse = -1 if( ( Value < -Limit ) or ( Value > Limit ) ) else 1
# ---------- end clamp ----------
clamp_2 = GhPythonScript(Value=deconstruct.YComponent, Limit=limit)  # -> Clamped, Reverse
# ---------- clamp_2: Python ----------
Clamped = -Limit if( Value < -Limit ) else Limit if( Value > Limit ) else Value
Reverse = -1 if( Value < -Limit or Value > Limit ) else 1
# ---------- end clamp_2 ----------
clamp_3 = GhPythonScript(Value=deconstruct.ZComponent, Limit=limit)  # -> Clamped, Reverse; same code as clamp_2
multiplication = Multiplication(A=deconstruct_vector.YComponent, B=clamp_2.Reverse)
multiplication_2 = Multiplication(A=deconstruct_vector.ZComponent, B=clamp_3.Reverse)
multiplication_3 = Multiplication(A=deconstruct_vector.XComponent, B=clamp.Reverse)
vector_xyz = VectorXYZ(XComponent=multiplication_3, YComponent=multiplication, ZComponent=multiplication_2)  # -> Vector, Length
construct_point = ConstructPoint(XCoordinate=clamp.Clamped, YCoordinate=clamp_2.Clamped, ZCoordinate=clamp_3.Clamped)

# ---- group: States
velocities_3 = Vector(vector_xyz.Vector)
positions_3 = Point(construct_point)
masses_3 = Number(masses_2)

# ----
stream_gate = StreamGate(Stream=limit, Gate=enable_2)  # -> Target0, Target1

# ---- group: Enable / Disable Constraints Bypass
stream_filter = StreamFilter(Gate=enable_2, Stream0=positions_2, Stream1=positions_3)
stream_filter_2 = StreamFilter(Gate=enable_2, Stream0=velocities_2, Stream1=velocities_3)
stream_filter_3 = StreamFilter(Gate=enable_2, Stream0=masses_2, Stream1=masses_3)

# ----
negative = Negative(Value=stream_gate.Target1)
construct_domain = ConstructDomain(DomainStart=negative, DomainEnd=stream_gate.Target1)

# ---- group: States
velocities_4 = Vector(stream_filter_2)
positions_4 = Point(stream_filter)
masses_4 = Number(stream_filter_3)

# ----
velocities_5 = ClusterOutput(velocities_4)
masses_5 = ClusterOutput(masses_4)
positions_5 = ClusterOutput(positions_4)
domain_box = DomainBox(Base=PlaneXY(0, 0, 0), X=construct_domain, Y=construct_domain, Z=construct_domain)
custom_preview = CustomPreview(Geometry=domain_box, Material=ColourSwatch(SwatchColor=RGBA(186, 187, 255, 0)))

# ==== cluster Display
velocities = ClusterInput()
positions = ClusterInput()
masses = ClusterInput()
forces = ClusterInput()
faces = ClusterInput()

# ---- group: State
velocities_2 = Vector(velocities)
positions_2 = Point(positions)
masses_2 = Number(masses)

# ----
forces_2 = Vector(forces)
faces_2 = MeshFace(faces)
construct_mesh = ConstructMesh(Vertices=positions_2, Faces=faces_2)

# ---- group: Force Visualization
scale = Slider(0.05, range=0..100)
multiplication = Multiplication(A=forces_2, B=scale)
vector_display_ex = VectorDisplayEx(Point=positions_2, Vector=multiplication, Colour=ColourSwatch(SwatchColor=RGB(168, 222, 53)), Width=5)

# ---- group: Velocity Visualization
scale_2 = Slider(0.1, range=0..100)
multiplication_2 = Multiplication(A=velocities_2, B=scale_2)
vector_display_ex_2 = VectorDisplayEx(Point=positions_2, Vector=multiplication_2, Colour=ColourSwatch(SwatchColor=RGB(255, 71, 71)), Width=5)

# ==== cluster Control
reset = ClusterInput()
initial = ClusterInput()
reset_2 = Boolean(reset)
initial_2 = Text(initial)
load = GhPythonScript(push=reset_2)  # -> data
# ---------- load: Python ----------
import Rhino
data = Rhino.RhinoDoc.ActiveDoc.Notes
# ---------- end load ----------
stream_filter = StreamFilter(Gate=reset_2, Stream0=load, Stream1=initial_2)
unpack = Unpack(text=stream_filter)  # -> positions_2, velocities_2, masses_2
positions = ClusterOutput(unpack.positions_2)
velocities = ClusterOutput(unpack.velocities_2)
masses = ClusterOutput(unpack.masses_2)

# ==== cluster Persist
positions = ClusterInput()
velocities = ClusterInput()
masses = ClusterInput()
pack = Pack(positions=positions, velocities=velocities, masses=masses)
save = GhPythonScript(data=pack)  # -> data
# ---------- save: Python ----------
import Rhino
Rhino.RhinoDoc.ActiveDoc.Notes = data
# ---------- end save ----------

# ==== cluster Sheet
count_x = ClusterInput()
count_y = ClusterInput()
mass = ClusterInput()
count_x_2 = Integer(count_x)
count_y_2 = Integer(count_y)
mass_2 = Number(mass)

# ---- group: Masses
subtraction = Subtraction(A=count_y_2, B="1")
addition = Addition(A=count_x_2, B="1")
subtraction_2 = Subtraction(A=count_x_2, B="1")
multiplication = Multiplication(A=subtraction, B=addition)
repeat_data = RepeatData(Data=mass_2, Length=subtraction_2)
# Corners have zero mass
repeat_data_2 = RepeatData(Data=mass_2, Length=multiplication)
entwine = Entwine(
    Branch00="0",
    Branch01=repeat_data,
    Branch02="0",
    Branch03=repeat_data_2,
    Branch04="0",
    Branch05=repeat_data,
    Branch06="0",
    FlattenInputs=True)  # -> flatten(Result)

# ---- group: Geometry and Topology
mesh_plane = MeshPlane(Boundary={Plane=PlaneXY(0, 0, 0), Size=Domain2(u=-10..10, v=-10..10)}, WidthCount=count_x_2, HeightCount=count_y_2)  # -> Mesh, Area
triangulate = Triangulate(Mesh=mesh_plane.Mesh)  # -> Mesh, Count
topo = Topo(mesh=triangulate.Mesh)  # -> nodes_2, faces_2, edges_2

# ---- group: Velocities
multiplication_2 = Multiplication(A=topo.nodes_2, B="0")

# ---- group: State
positions = Point(topo.nodes_2)
velocities = Vector(multiplication_2)
masses = Number(entwine)

# ----
panel = Panel(entwine)
pack = Pack_2(positions=positions, velocities=velocities, masses=masses)
initial = Text(pack)
faces = MeshFace(topo.faces_2)
edges = Integer(topo.edges_2)
edges_2 = ClusterOutput(edges)
faces_2 = ClusterOutput(faces)
initial_2 = ClusterOutput(initial)

# ==== cluster Analysis
velocities = ClusterInput()
positions = ClusterInput()
masses = ClusterInput()
edges = ClusterInput()
edges_2 = Integer(edges)

# ---- group: State
velocities_2 = Vector(velocities)
positions_2 = Point(positions)
masses_2 = Number(masses)

# ---- group: Forces
k = Slider(2, range=0..10)
L = Slider(4, range=0..10)
k_2 = Slider(20, range=0..100)
g = Slider(-10, range=-10..10)
gravity = Gravity(acceleration=g, mass=masses_2)
springs = Springs(positions=positions_2, edges=edges_2, rest_length=L, stiffness=k_2)
drag = Drag(velocity=velocities_2, factor=k)

# ---- group: Sumation
addition = Addition(A=springs, B=drag)
addition_2 = Addition(A=addition, B=gravity)
sumforces = Vector(addition_2)

# ----
sumforces_2 = ClusterOutput(sumforces)

# ==== cluster Unpack
text = ClusterInput()
text_split = TextSplit(Text=text, Separators=";")
text_split_2 = TextSplit(Text=text_split, Separators=",")
list_item = ListItem(List=text_split_2, Index=0, Wrap=True)  # -> Item, Item1, Item2, Item3, Item4, Item5, Item6
vector_xyz = VectorXYZ(XComponent=list_item.Item3, YComponent=list_item.Item4, ZComponent=list_item.Item5)  # -> Vector, Length
construct_point = ConstructPoint(XCoordinate=list_item.Item, YCoordinate=list_item.Item1, ZCoordinate=list_item.Item2)

# ---- group: States
velocities = Vector(flatten(vector_xyz.Vector))
positions = Point(flatten(construct_point))
masses = Number(flatten(list_item.Item6))

# ----
masses_2 = ClusterOutput(masses)
positions_2 = ClusterOutput(positions)
velocities_2 = ClusterOutput(velocities)

# ==== cluster Pack
positions = ClusterInput()
velocities = ClusterInput()
masses = ClusterInput()

# ---- group: State
positions_2 = Point(positions)
velocities_2 = Vector(velocities)
masses_2 = Number(masses)

# ----
deconstruct_vector = DeconstructVector(Vector=velocities_2)  # -> XComponent, YComponent, ZComponent
deconstruct = Deconstruct(Point=positions_2)  # -> XComponent, YComponent, ZComponent
entwine = Entwine(
    Branch00=deconstruct.XComponent,
    Branch01=deconstruct.YComponent,
    Branch02=deconstruct.ZComponent,
    Branch03=deconstruct_vector.XComponent,
    Branch04=deconstruct_vector.YComponent,
    Branch05=deconstruct_vector.ZComponent,
    Branch06=masses_2,
    FlattenInputs=True)
flip_matrix = FlipMatrix(Data=entwine)
text_join = TextJoin(Text=flip_matrix, Join=",")  # -> flatten(Result)
text_join_2 = TextJoin(Text=text_join, Join=";")
result = ClusterOutput(text_join_2)

# ==== cluster Topo
# Triangle: U = T.B if( I == T.A ) else T.C if( I == T.B ) else T.A if( I == T.C ) else -1
# V = T.C if( I == T.A ) else T.A if( I == T.B ) else T.B if( I == T.C ) else -1
# Quadrilateral: U = T.B if( I == T.A ) else T.C if( I == T.B ) else T.D if( I == T.C ) else T.A if( I == T.D ) else -1
# V = T.D if( I == T.A ) else T.A if( I == T.B ) else T.B if( I == T.C ) else T.C if( I == T.D ) else -1
mesh = ClusterInput()
mesh_2 = Mesh(mesh)
deconstruct_mesh = DeconstructMesh(Mesh=mesh_2)  # -> Vertices, Faces, Colours, Normals

list_length = ListLength(List=deconstruct_mesh.Vertices)
series = Series(Start=0, Step=1, Count=list_length)

panel = Panel("""if( T.IsQuad ):
  if( I == T.A ):
    U = T.B
    V = T.D
  else:
    if( I == T.B ):
      U = T.C
      V = T.A
    else:
      if( I == T.C ):
        U = T.D
        V = T.B
      else:
        if( I == T.D ):
          U = T.A
          V = T.C
        else:
          U = -1
          V = -1
else:
  if( I == T.A ):
    U = T.B
    V = T.C
  else:
    if( I == T.B ):
      U = T.C
      V = T.A
    else:
      if( I == T.C ):
        U = T.A
        V = T.B
      else:
        U = -1
        V = -1""")
panel_2 = Panel(deconstruct_mesh.Faces)
python = GhPythonScript(T=graft(deconstruct_mesh.Faces), I=series)  # -> out, U, V
# ---------- python: Python ----------
if (I == T.A):
    U = T.B
else:
    if (I == T.B):
        U = T.C
    else:
        if (I==T.C):
            U = T.A
        else:
            U = -1
# ---------- end python ----------

# ---- group: Point in Edge
ghpython_script = GhPythonScript(Code=panel, T=graft(deconstruct_mesh.Faces), I=series)  # -> Out, U, V

# ----
panel_3 = Panel(python.U)
a_b_c = Panel(ghpython_script.U)

# ---- group: Reshape Indices
flip_matrix = FlipMatrix(Data=ghpython_script.U)
flip_matrix_2 = FlipMatrix(Data=ghpython_script.V)
merge = Merge(Data1=flip_matrix, Data2=flip_matrix_2)

# ----
the_other_direction = Panel(ghpython_script.V)

# ---- group: Remove Duplicates
create_set = CreateSet(List=merge)  # -> Set, Map

# ----
integer = Integer(-1)

# ---- group: Remove Invalid
set_difference = SetDifference(SetA=create_set.Set, SetB=graft(integer))  # -> simplify(Union)

# ----
edges = Integer(set_difference)
nodes = Point(deconstruct_mesh.Vertices)
faces = MeshFace(deconstruct_mesh.Faces)
panel_4 = Panel(set_difference)
nodes_2 = ClusterOutput(nodes)
faces_2 = ClusterOutput(faces)
edges_2 = ClusterOutput(edges)
viewer = ParamViewer(set_difference)

# ==== cluster Pack_2
positions = ClusterInput()
velocities = ClusterInput()
masses = ClusterInput()

# ---- group: States
positions_2 = Point(positions)
velocities_2 = Vector(velocities)
masses_2 = Number(masses)

# ----
deconstruct_vector = DeconstructVector(Vector=velocities_2)  # -> XComponent, YComponent, ZComponent
deconstruct = Deconstruct(Point=positions_2)  # -> XComponent, YComponent, ZComponent
entwine = Entwine(
    Branch00=deconstruct.XComponent,
    Branch01=deconstruct.YComponent,
    Branch02=deconstruct.ZComponent,
    Branch03=deconstruct_vector.XComponent,
    Branch04=deconstruct_vector.YComponent,
    Branch05=deconstruct_vector.ZComponent,
    Branch06=masses_2,
    FlattenInputs=True)
flip_matrix = FlipMatrix(Data=entwine)
text_join = TextJoin(Text=flip_matrix, Join=",")  # -> flatten(Result)
text_join_2 = TextJoin(Text=text_join, Join=";")
result = ClusterOutput(text_join_2)

# ==== cluster Gravity
mass = ClusterInput()
acceleration = ClusterInput()
mass_2 = Number(mass)
acceleration_2 = Number(acceleration)
unit_z = UnitZ(Factor=acceleration_2)
negative = Negative(Value=unit_z)
multiplication = Multiplication(A=negative, B=mass_2)
force = Vector(multiplication)
force_2 = ClusterOutput(force)

# ==== cluster Drag
velocity = ClusterInput()
factor = ClusterInput()
velocity_2 = Vector(velocity)
factor_2 = Number(factor)
multiplication = Multiplication(A=velocity_2, B=factor_2)
negative = Negative(Value=multiplication)
force = Vector(negative)
force_2 = ClusterOutput(force)

# ==== cluster Springs
rest_length = ClusterInput()
positions = ClusterInput()
stiffness = ClusterInput()
edges = ClusterInput()
positions_2 = Point(positions)
edges_2 = Integer(edges)
rest_length_2 = Number(rest_length)
stiffness_2 = Number(stiffness)
list_item = ListItem(List=positions_2, Index=edges_2, Wrap=True)

# ---- group: Forces
vector_2pt = Vector2Pt(PointA=list_item, PointB=graft(positions_2), Unitize=False)  # -> Vector, Length
subtraction = Subtraction(A=rest_length_2, B=vector_2pt.Length)
unit_vector = UnitVector(Vector=vector_2pt.Vector)
multiplication = Multiplication(A=subtraction, B=stiffness_2)
multiplication_2 = Multiplication(A=unit_vector, B=multiplication)

# ---- group: Partial Sums
mass_addition = MassAddition(Input=multiplication_2)  # -> flatten(Result), PartialResults
force = Vector(mass_addition.Result)

# ----
force_2 = ClusterOutput(force)
