# Grasshopper definition ctd-assignment-2.gh (Grasshopper 1.0.7)

size = Slider(3.4, range=1..5)
density = Slider(18, range=1..30)
height = Slider(6, range=0..6)
city_center = Slider(10, range=0..10)

ghpython_script = GhPythonScript(size=size, density=density, height=height, center=city_center)  # -> out, xarray, yarray, zarray, radius
# ---------- ghpython_script: Python ----------
import rhinoscriptsyntax as rs
import math

## Get points between 0 and pi
max =  size*math.pi
step = (size*math.pi)/density

xarray = []
yarray = []
zarray = []
points = 0

y = 0

while y <= max:
    x = 0
    ## Nested while loop to create a "2d-list", similar to grafting
    while x <= max:
        xarray += [x]
        yarray += [y]
        
        z = 0.3 + height*((math.sin(x + center))*(math.sin(y + center)))**2
        zarray += [z]
        
        x += step
        points += 1
    
    y += step
# ---------- end ghpython_script ----------

division = Division(A=ghpython_script.zarray, B=2)
subtraction = Subtraction(A=division, B=0.3)
division_2 = Division(A=subtraction, B=2)
multiplication = Multiplication(A=subtraction)
colour_rgb_f = ColourRGBF(Alpha=1, Red=division_2, Green=subtraction, Blue=multiplication)

construct_point = ConstructPoint(XCoordinate=ghpython_script.xarray, YCoordinate=ghpython_script.yarray, ZCoordinate=0)
circle_cnr = CircleCNR(Center=construct_point, Normal=Vector(0, 0, 1), Radius=0.5)
cylinder = Cylinder(Base=circle_cnr, Radius=0.4, Length=ghpython_script.zarray)
bounding_box = BoundingBox(Content=cylinder, Plane=PlaneXY(0, 0, 0))  # -> Box, Box_2
custom_preview = CustomPreview(Geometry=bounding_box.Box, Material=colour_rgb_f)
