# Grasshopper definition 1_1_RangeTransformations.gh (Grasshopper 1.0.7)

# Graph a sine, cosine curve
# Graph a circle
int = Integer(0)
int_2 = Integer(1)
pt = Point()
fib = Fibonacci(SeedA=int, SeedB=int_2, Number=10)
# 10.014 CTD
# Associative Modelling
# Part 1
panel = Panel(fib)
