# Grasshopper definition 3B_Bridge-09.gh (Grasshopper 1.0.7)

# ---- group: Points
half_pi = Number(1.570796327)

# ---- group: Controls
curve = Curve(reparameterize(<curve referenced from the Rhino model>))
cycles = Slider(-3.571817, range=-10..10)
phase = Slider(2.342, range=0..10)
min_radius = Slider(5.682, range=0..10)
max_radius = Slider(6.464, range=0..10)
count = Slider(33, range=4..64)

# ---- group: Spine
series = Series(Start=0, Step=expr("1 / ( x - 1)", count), Count=count)

# ---- group: Controls (continued)
graph_mapper = GraphMapper(series, x0=0, x1=1, y0=0, y1=1, container_name="Bezier", cpx=[0, 0.25, 0.75, 1], cpy=[0, 0.25, 0.75, 1])
graph_mapper_2 = GraphMapper(series, x0=0, x1=1, y0=0, y1=1, container_name="Bezier", cpx=[0, 0.25, 0.75, 1], cpy=[0, 0.25, 0.75, 1])
graph_mapper_3 = GraphMapper(
    series,
    x0=0,
    x1=1,
    y0=0,
    y1=1,
    amplitude=0.5224874616,
    container_name="Perlin",
    decay=0.9468976259,
    frequency=0.3450184762,
    x_offset=0.5307617188,
    y_offset=0.4775125384)

# ---- group: Spine (continued)
expression = Expression(t=graph_mapper_3, minimum=min_radius, maximum=max_radius, Expression="minimum * ( 1.0 - t ) + maximum * t")
curve_frame = CurveFrame(Curve=curve, Parameter=graph_mapper)
deconstruct_plane = DeconstructPlane(Plane=curve_frame)  # -> Origin, XAxis, YAxis, ZAxis
multiplication = Multiplication(A=cycles, B=graph_mapper_2)
binormal = Vector(deconstruct_plane.ZAxis)
tangent = Vector(deconstruct_plane.XAxis)
normal = Vector(deconstruct_plane.YAxis)
number = Number(multiplication)
number_2 = Number(expression)

# ---- group: Points / Points B
multiplication_2 = Multiplication(A=series, B=number)
addition = Addition(A=phase, B=half_pi)
addition_2 = Addition(A=multiplication_2, B=addition)
cosine = Cosine(Value=addition_2)
sine = Sine(Value=addition_2)
multiplication_3 = Multiplication(A=number_2, B=cosine)
multiplication_4 = Multiplication(A=number_2, B=sine)
multiplication_5 = Multiplication(A=normal, B=multiplication_3)
multiplication_6 = Multiplication(A=binormal, B=multiplication_4)
addition_3 = Addition(A=multiplication_5, B=multiplication_6)
addition_4 = Addition(A=deconstruct_plane.Origin, B=addition_3)

# ---- group: Points / Points A
multiplication_7 = Multiplication(A=series, B=number)
addition_5 = Addition(A=multiplication_7, B=phase)
cosine_2 = Cosine(Value=addition_5)
sine_2 = Sine(Value=addition_5)
multiplication_8 = Multiplication(A=number_2, B=cosine_2)
multiplication_9 = Multiplication(A=number_2, B=sine_2)
multiplication_10 = Multiplication(A=normal, B=multiplication_8)
multiplication_11 = Multiplication(A=binormal, B=multiplication_9)
addition_6 = Addition(A=multiplication_10, B=multiplication_11)
addition_7 = Addition(A=deconstruct_plane.Origin, B=addition_6)

# ---- group: Points / Points C
multiplication_12 = Multiplication(A=series, B=number)
addition_8 = Addition(A=addition, B=half_pi)
addition_9 = Addition(A=multiplication_12, B=addition_8)
cosine_3 = Cosine(Value=addition_9)
sine_3 = Sine(Value=addition_9)
multiplication_13 = Multiplication(A=number_2, B=cosine_3)
multiplication_14 = Multiplication(A=number_2, B=sine_3)
multiplication_15 = Multiplication(A=normal, B=multiplication_13)
multiplication_16 = Multiplication(A=binormal, B=multiplication_14)
addition_10 = Addition(A=multiplication_15, B=multiplication_16)
addition_11 = Addition(A=deconstruct_plane.Origin, B=addition_10)

# ---- group: Points / Points D
multiplication_17 = Multiplication(A=series, B=number)
addition_12 = Addition(A=addition_8, B=half_pi)
addition_13 = Addition(A=multiplication_17, B=addition_12)
cosine_4 = Cosine(Value=addition_13)
sine_4 = Sine(Value=addition_13)
multiplication_18 = Multiplication(A=number_2, B=cosine_4)
multiplication_19 = Multiplication(A=number_2, B=sine_4)
multiplication_20 = Multiplication(A=normal, B=multiplication_18)
multiplication_21 = Multiplication(A=binormal, B=multiplication_19)
addition_14 = Addition(A=multiplication_20, B=multiplication_21)
addition_15 = Addition(A=deconstruct_plane.Origin, B=addition_14)

# ---- group: Centerlines
polyline = PolyLine(Vertices=addition_7, Closed=False)
polyline_2 = PolyLine(Vertices=addition_4, Closed=False)
polyline_3 = PolyLine(Vertices=addition_11, Closed=False)
polyline_4 = PolyLine(Vertices=addition_15, Closed=False)
line = Line(StartPoint=addition_7, EndPoint=addition_4)
line_2 = Line(StartPoint=addition_4, EndPoint=addition_11)
line_3 = Line(StartPoint=addition_11, EndPoint=addition_15)
line_4 = Line(StartPoint=addition_15, EndPoint=addition_7)
shift_list = ShiftList(List=addition_4, Shift=-1, Wrap=True)
shift_list_2 = ShiftList(List=addition_7, Shift=-1, Wrap=True)
shift_list_3 = ShiftList(List=addition_11, Shift=-1, Wrap=True)
shift_list_4 = ShiftList(List=addition_15, Shift=-1, Wrap=True)
split_list = SplitList(List=addition_11, Index=1)  # -> ListA, ListB
split_list_2 = SplitList(List=shift_list, Index=1)  # -> ListA, ListB
split_list_3 = SplitList(List=addition_4, Index=1)  # -> ListA, ListB
split_list_4 = SplitList(List=shift_list_2, Index=1)  # -> ListA, ListB
split_list_5 = SplitList(List=addition_15, Index=1)  # -> ListA, ListB
split_list_6 = SplitList(List=addition_7, Index=1)  # -> ListA, ListB
split_list_7 = SplitList(List=shift_list_3, Index=1)  # -> ListA, ListB
split_list_8 = SplitList(List=shift_list_4, Index=1)  # -> ListA, ListB
line_5 = Line(StartPoint=split_list_2.ListB, EndPoint=split_list.ListB)
line_6 = Line(StartPoint=split_list_4.ListB, EndPoint=split_list_3.ListB)
line_7 = Line(StartPoint=split_list_7.ListB, EndPoint=split_list_5.ListB)
line_8 = Line(StartPoint=split_list_8.ListB, EndPoint=split_list_6.ListB)

# ---- group: Dress-up Geometry
merge = Merge(Data1=line_6, Data2=line_5, Data3=line_7, Data4=line_8)
merge_2 = Merge(Data1=line, Data2=line_2, Data3=line_3, Data4=line_4)
merge_3 = Merge(Data1=polyline, Data2=polyline_2, Data3=polyline_3, Data4=polyline_4)
explode = Explode(Curve=merge_3, Recursive=True)  # -> flatten(Segments), Vertices
merge_4 = Merge(Data1=explode.Segments, Data2=merge_2, Data3=merge)  # -> flatten(Result)
pipe = Pipe(Curve=merge_4, Radius=Slider(0.4, range=0..1), Caps=0)  # disabled

# ---- group: Performance
number_slider = Slider(300, range=0..1000)
length = Length(Curve=merge_4)
mass_addition = MassAddition(Input=length)  # -> Result, PartialResults
bar_graph = BarGraph(length, BarColor=RGB(255, 0, 90))
gradient = Gradient(LowerLimit=5, UpperLimit=15, Parameter=length, stops=[0: RGB(0, 128, 0), 0.5: RGB(255, 255, 0), 1: RGB(255, 0, 0)])
multiplication_22 = Multiplication(A=mass_addition.Result, B=number_slider)
integer = Integer(multiplication_22)
cost = Panel(integer)
custom_preview = CustomPreview(Geometry=merge_4, Material=gradient)  # disabled
