# Grasshopper definition 3b.gh (Grasshopper 1.0.7)

number_slider = Slider(4, range=0..10)
series = Series(Start=0, Step=number_slider, Count=number_slider)
curve = Curve()
curve_frame = CurveFrame(Curve=curve, Parameter=series)
