# Grasshopper definition ctd-1d.gh (Grasshopper 1.0.7)

height = Slider(1000, range=30..1000)
radius = Slider(12, range=7..20)
ghpython_script = GhPythonScript(radius=radius, height=height)  # -> out, circlex, circley, circlez, theta
# ---------- ghpython_script: Python ----------
__author__ = "tanru"
__version__ = "2024.10.01"

import rhinoscriptsyntax as rs
import math

circlex = []
circley = []
circlez = []
theta = []

for i in range(int(height)):
    cx = (radius*4)*math.sin(i*0.1*math.pi)
    circlex += [cx]
    
    cy = (radius*4)*math.cos(i*0.1*math.pi)
    circley += [cy]
    
    cz = (i - height/2)/4
    circlez += [cz]
    
    theta += [i*0.1*math.pi]
# ---------- end ghpython_script ----------
multiplication = Multiplication(A=Slider(2, range=-2..2), B=ghpython_script.theta)
vector_xyz = VectorXYZ(XComponent=-1, YComponent=0, ZComponent=0)  # -> Vector, Length
construct_point = ConstructPoint(XCoordinate=ghpython_script.circlex, YCoordinate=multiplication, ZCoordinate=0)
construct_point_2 = ConstructPoint(XCoordinate=ghpython_script.circlex, YCoordinate=ghpython_script.circley, ZCoordinate=ghpython_script.circlez)
construct_point_3 = ConstructPoint(XCoordinate=ghpython_script.circlez, YCoordinate=ghpython_script.circley, ZCoordinate=ghpython_script.circlex)
construct_point_4 = ConstructPoint(XCoordinate=ghpython_script.circlex, YCoordinate=ghpython_script.circlez, ZCoordinate=ghpython_script.circley)
construct_plane = ConstructPlane(Origin=construct_point_2, XAxis=construct_point_2, YAxis=vector_xyz.Vector)
polyline = PolyLine(Vertices=construct_point_2, Closed=False)
circle_cnr = CircleCNR(Center=construct_point_3, Normal=construct_point_3, Radius=radius)
circle_cnr_2 = CircleCNR(Center=construct_point_2, Normal=construct_point, Radius=radius)
circle_cnr_3 = CircleCNR(Center=construct_point_4, Normal=construct_point_4, Radius=radius)
circle = Circle(Plane=construct_plane, Radius=4)
colour_rgb_f = ColourRGBF(Alpha=1, Red=0, Green=construct_point_2, Blue=0)
colour_rgb_f_2 = ColourRGBF(Alpha=1, Red=ghpython_script.circlez, Green=ghpython_script.circley, Blue=ghpython_script.circlex)
colour_rgb_f_3 = ColourRGBF(Alpha=1, Red=construct_point_3, Green=0, Blue=0)
colour_rgb = ColourRGB(Alpha=255, Red=0, Green=0, Blue=0)
colour_rgb_f_4 = ColourRGBF(Alpha=1, Red=0.2, Green=0.78, Blue=0.95)
custom_preview = CustomPreview(Geometry=circle_cnr_3, Material=colour_rgb_f_4)
custom_preview_2 = CustomPreview(Geometry=circle_cnr_2, Material=colour_rgb_f)
custom_preview_3 = CustomPreview(Geometry=circle_cnr, Material=colour_rgb_f_3)
custom_preview_4 = CustomPreview(Geometry=polyline, Material=colour_rgb)
custom_preview_5 = CustomPreview(Geometry=circle, Material=colour_rgb_f_2)
